# Grasshopper definition robotic_drawing.ghx (Grasshopper 1.0.7)
# Copyright: © 2021 Ko Tsuruta
# plug-ins: KUKA|prc - parametric robot control

# ----
# run simulation
manual_sim = Slider(0, range=0..1)
animate_sim = Panel("1000")
list = ValueList({"animate": 0, "manual": 1}, selected="animate")
smooth = SmoothNumbers(Numbers=animate_sim, SmoothDelay=10000)
dom = ConstructDomain(DomainStart=0, DomainEnd=1)
dom_2 = ConstructDomain(DomainStart=0, DomainEnd=animate_sim)
remap = RemapNumbers(Value=smooth, Source=dom_2, Target=dom)  # -> Mapped, Clipped
filter = StreamFilter(Gate=list, Stream0=remap.Mapped, Stream1=manual_sim)

# ----
# check plane
number_slider = Slider(500, range=0..1000)

# ----
# save file
filename = Panel("test")
save = Button()

# ---- group: design
# Grasshopper example
number_slider_2 = Slider(1, range=0..1)
number_slider_3 = Slider(10, range=0..10)
crv = Curve(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)
crv_2 = Curve(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)
subtraction = Subtraction(A=number_slider_3, B=1)
division = Division(A=number_slider_2, B=subtraction)
series = Series(Start=0, Step=division, Count=number_slider_3)
tweencrv = TweenCurve(CurveA=crv_2, CurveB=crv, Factor=series, BlendType=0)

# ----
# robot model
kr6_10_r1100_2 = AgilusKR610R11002Robot(infiniterot=False)

pt = ConstructPoint(XCoordinate=number_slider, YCoordinate=0, ZCoordinate=Slider(500, range=0..1000))
X = UnitX(Factor=1)
Y = UnitY(Factor=1)
pl = ConstructPlane(Origin=pt, XAxis=expr("-x", X), YAxis=Y)
xy = XYPlane(Origin=pt)
xz = XZPlane(Origin=pt)
rotate = Rotate(Geometry=xy, Angle=3.141592654, Plane=xz)  # -> Geometry, Transform

# ---- group: flip
dispatch = Dispatch(List=tweencrv, DispatchPattern=[True, False])  # -> ListA, ListB
flip = FlipCurve(Curve=dispatch.ListB)  # -> Curve, Flag
weave = Weave(Pattern=[0, 1], Stream0=dispatch.ListA, Stream1=flip.Curve, NullGaps=False)

# ---- group: create plane
divide = DivideCurve(Curve=weave, Count=10, Kinks=False)  # -> Points, Tangents, Parameters
eval = EvaluateCurve(Curve=graft(weave), Parameter=divide.Parameters)  # -> Point, Tangent, Angle
Z = UnitZ(Factor=1)
xprod = CrossProduct(VectorA=Z, VectorB=eval.Tangent, Unitize=False)  # -> Vector, Length
pl_2 = ConstructPlane(Origin=eval.Point, XAxis=xprod.Vector, YAxis=eval.Tangent)
vdis = VectorDisplay(Anchor=eval.Point, Vector=xprod.Vector)
flatten = FlattenTree(Tree=pl_2, Path="{0}")

# ----
# KUKA core
lin_move = LINearMovementKUKAPrc(TargetAsPlane=flatten, extaxenabled=False, interpolation="C_DIS")
kuka_prc = KUKAPrcCORE(
    SimulationSlider=filter,
    KUKAPrcCommands=lin_move,
    Robot=kr6_10_r1100_2,
    SaveToggle=save,
    Filename=filename,
    PRC_BaseExpose=False,
    PRC_SaveNameExpose=True,
    PRCsettings="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")  # -> RobotGeometry, AnalysisOutput

# ----
# Python example
filename_2 = Panel("test_manual.src")
crv_3 = Curve(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)
crv_4 = Curve(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)

# ----
# Design example
python = GhPythonScript(Crv1=crv_3, Crv2=crv_4)  # -> Out, Way_planes

# ----
# KRL
kuka_code = GhPythonScript(way_planes=python.Way_planes, filename=filename_2, save=Toggle(True))  # -> out, krl_code; inputs way_planes: list, save: Boolean
# ---------- kuka_code: Python ----------
"""ABOUT
    This file is an example template of a python file.
"""

# ------------------------------------------------------------------------------
# modules
# ------------------------------------------------------------------------------

import compas_ghpython
from krl import KukaPython


# ------------------------------------------------------------------------------
# hard code values & routines
# ------------------------------------------------------------------------------

compas_ghpython.utilities.unload_modules("krl")

_hardcode_value = 0
# tool coordinates
tx, ty, tz, ta, tb, tc = 0, 0, 0, 0, 0, 0
# base coordinates
bx, by, bz, ba, bb, bc = 0, 0, 0, 0, 0, 0

# ------------------------------------------------------------------------------
# functions
# ------------------------------------------------------------------------------

# ------------------------------------------------------------------------------
# classes
# ------------------------------------------------------------------------------

# ------------------------------------------------------------------------------
# run code
# ------------------------------------------------------------------------------

# create instance of KukaPython
k = KukaPython("my_kuka")

# set tool properties
#k.setToolNumber(0)
k.setToolCoordinates(tx, ty, tz, ta, tb, tc)

# set base properties
#k.setBaseNumber(0)
k.setBaseCoordinates(bx, by, bz, ba, bb, bc)

# run code

# save code
if save:
    KRL = k.saveFile(filename)
    
    krl_code = ""
    for krl in KRL:
        krl_code += krl
        krl_code += "\n"
# ---------- end kuka_code ----------

txt = Text(kuka_code.krl_code)
